# Grasshopper definition esercitazione_1.gh (Grasshopper 1.0.8)

number_slider = Slider(200, range=0..1000)
sqgrid = Square(Plane=PlaneXY(0, 0, 0), Size=Slider(1, range=0..1), ExtentX=number_slider, ExtentY=number_slider)  # -> Cells, Points
area = Area(Geometry=sqgrid.Cells)  # -> Area, Centroid
image = ImageSampler(
    area.Centroid,
    FilePath="E:\FOTO\download\springtrap_rare_screen_icon_recreation_by_btb_tv_deopzt2-fullview.png",
    Filter="Value",
    Interpolate=False,
    Umax=200,
    Umin=1,
    Vmax=200,
    Vmin=1,
    Wrap=1)
bnd = Bounds(Numbers=image)
dom = ConstructDomain(DomainStart=Slider(0.76, range=0..1), DomainEnd=Slider(0, range=0..100))
remap = RemapNumbers(Value=image, Source=bnd, Target=dom)  # -> Mapped, Clipped
circle = CircleCNR(Center=area.Centroid, Normal=Vector(0, 0, 1), Radius=remap.Mapped)
preview = CustomPreview(Geometry=circle, Material=ColourSwatch(SwatchColor=RGB(0, 0, 0)))
