# Grasshopper definition esercitazione_2.gh (Grasshopper 1.0.8)

number_slider = Slider(100, range=0..100)
box = CenterBox(Base=PlaneXY(0, 0, 0), X=number_slider, Y=number_slider, Z=number_slider)
debrep = DeconstructBrep(Brep=box)  # -> Faces, Edges, Vertices
sph = Sphere(Base=debrep.Vertices, Radius=Slider(100, range=0..100))
sph_2 = Sphere(Base=debrep.Faces, Radius=Slider(0, range=0..100))
sdiff = SolidDifference(BrepsA=box, BrepsB=[sph_2, sph])
preview = CustomPreview(
    Geometry=sdiff,
    Material={diffuse=RGB(221, 160, 221), emission=RGB(66, 48, 66), shine=0.5, specular=RGB(255, 255, 255), transparency=0})
