# Grasshopper definition esercitazione_3.gh (Grasshopper 1.0.8)

number_slider = Slider(10, range=0..100)
box = CenterBox(Base=PlaneXY(0, 0, 0), X=number_slider, Y=number_slider, Z=number_slider)
knob = ControlKnob(Decimals=0, Limit=True, Maximum=360, Minimum=0, Range=360, Value=0)
Z = UnitZ(Factor=Slider(6, range=0..20))
neg = Negative(Value=knob)
xz = XZPlane(Origin=Point(0, 0, 0))
cyl = Cylinder(Base=Z, Radius=Slider(4, range=0..100), Length=Slider(14, range=0..100))
cap = CapHoles(Brep=cyl)
rotate = Rotate(Geometry=cap, Angle=degrees(neg), Plane=xz)  # -> Geometry, Transform
knob_2 = ControlKnob(Decimals=0, Limit=True, Maximum=360, Minimum=0, Range=360, Value=360)
neg_2 = Negative(Value=knob_2)
xz_2 = XZPlane(Origin=Point(0, 0, 0))
yz = YZPlane(Origin=Point(0, 0, 0))
arrpolar = PolarArray(Geometry=rotate.Geometry, Plane=[yz, xz_2], Count=Slider(6, range=0..10), Angle=degrees(neg_2))  # -> Geometry, Transform
sdiff = SolidDifference(BrepsA=box, BrepsB=flatten(arrpolar.Geometry))
preview = CustomPreview(
    Geometry=sdiff,
    Material={diffuse=RGB(221, 160, 221), emission=RGB(66, 48, 66), shine=0.5, specular=RGB(255, 255, 255), transparency=0})
