# Grasshopper definition esercitazione_4.gh (Grasshopper 1.0.8)

number_slider = Slider(60, range=0..100)
sqgrid = Square(Plane=PlaneXY(0, 0, 0), Size=Slider(1, range=0..1), ExtentX=number_slider, ExtentY=number_slider)  # -> Cells, Points
area = Area(Geometry=sqgrid.Cells)  # -> Area, Centroid
pt = Point([<point referenced from the Rhino model> x3])
cp = ClosestPoint(Point=flatten(area.Centroid), Cloud=flatten(pt))  # -> ClosestPoint, CPIndex, Distance
bnd = Bounds(Numbers=cp.Distance)
remap = RemapNumbers(Value=flatten(cp.Distance), Source=flatten(bnd), Target=Domain(0, 1))  # -> Mapped, Clipped
graph = GraphMapper(
    remap.Mapped,
    x0=0,
    x1=1,
    y0=0,
    y1=1,
    container_name="Bezier",
    cpx=[0, 0.5724796653, 0.2704122663, 1],
    cpy=[0.167681694, 0, 1, 0.8095752001])
gradient = Gradient(LowerLimit=0, UpperLimit=1, Parameter=graph, stops=[0.496: RGB(0, 0, 160), 0.85: RGB(220, 0, 40)])
scale = Scale(Geometry=flatten(sqgrid.Cells), Center=flatten(area.Centroid), Factor=flatten(graph))  # -> Geometry, Transform
boundary = BoundarySurfaces(Edges=scale.Geometry)
preview = CustomPreview(Geometry=boundary, Material=gradient)
