# Grasshopper definition esercitazione_X.gh (Grasshopper 1.0.8)

number_slider = Slider(20, range=0..100)
square = Square(Plane=PlaneXY(0, 0, 0), Size=Slider(60, range=0..100), ExtentX=number_slider, ExtentY=number_slider)  # -> Cells, Points
point = Point(square.Points)
curve = Curve()
pull_point = PullPoint(Point=point, Geometry=curve, ClosestOnly=True)  # -> ClosestPoint, Distance, Index
panel = Panel(square.Cells)
number_slider_2 = Slider(20, range=0..100)
panel_2 = Panel(square.Points)
division = Division(A=pull_point.Distance, B=Slider(20, range=0..100))
panel_3 = Panel(division)
secant = Secant(Value=division)
panel_4 = Panel(secant)
bounds = Bounds(Numbers=secant)
deconstruct_domain = DeconstructDomain(Domain=bounds)  # -> Start, End
construct_domain = ConstructDomain(DomainStart=deconstruct_domain.End, DomainEnd=deconstruct_domain.Start)
panel_5 = Panel(construct_domain)
remap_numbers = RemapNumbers(Value=secant, Source=bounds, Target=construct_domain)  # -> Mapped, Clipped
stream_filter = StreamFilter(Gate="0", Stream0=secant, Stream1=remap_numbers.Mapped)
number_slider_3 = Slider(60, range=0..60)
division_2 = Division(A=stream_filter, B=Slider(15, range=0..100))
panel_6 = Panel(division_2)
domain_box = DomainBox(Base=pull_point.ClosestPoint, X=number_slider_3, Y=number_slider_3, Z=division_2)
panel_7 = Panel(domain_box)
larger_than = LargerThan(FirstNumber=division_2, SecondNumber=Slider(55, range=0..100))  # -> LargerThan, OrEqualTo
cull_pattern = CullPattern(List=domain_box, CullPattern=larger_than.LargerThan)
geometry = Geometry(cull_pattern)
panel_8 = Panel(larger_than.LargerThan)
custom_preview = CustomPreview(Geometry=geometry, Material=ColourSwatch(SwatchColor=RGB(27, 34, 255)))
