# Grasshopper definition pattern_ripple.gh (Grasshopper 1.0.8)

time = Slider(60, range=0..60)
number_slider = Slider(67, range=0..100)
pt = Point([<point referenced from the Rhino model> x3])
planesrf = PlaneSurface(Plane=PlaneXY(0, 0, 0), XSize="-0.5 To 0.5", YSize="-0.5 To 0.5")
sqgrid = Square(Plane=PlaneXY(0, 0, 0), Size=Slider(1, range=0..1), ExtentX=number_slider, ExtentY=number_slider)  # -> Cells, Points
mesh = Mesh(planesrf)
area = Area(Geometry=sqgrid.Cells)  # -> Area, Centroid
cp = ClosestPoint(Point=flatten(area.Centroid), Cloud=flatten(pt))  # -> ClosestPoint, CPIndex, Distance
subtraction = Subtraction(A=cp.Distance, B=time)
move = Move(Geometry=mesh, Motion=area.Centroid)  # -> Geometry, Transform
abs = Absolute(Value=subtraction)
remap = RemapNumbers(Value=flatten([cp.Distance, abs]), Source=flatten(abs), Target=Domain(0, 1))  # -> Mapped, Clipped
graph = GraphMapper(
    remap.Mapped,
    x0=0,
    x1=1,
    y0=0,
    y1=1,
    container_name="Bezier",
    cpx=[0, 0.6899086833, 1, 1],
    cpy=[0.06679701805, 0, 1, 0.931912303])
gradient = Gradient(LowerLimit=0, UpperLimit=1, Parameter=graph, stops=[0.496: RGB(0, 0, 160), 0.85: RGB(220, 0, 40)])
scale = Scale(Geometry=flatten(move.Geometry), Center=flatten(area.Centroid), Factor=flatten(graph))  # -> Geometry, Transform
preview = CustomPreview(Geometry=scale.Geometry, Material=gradient)
