# Grasshopper definition pattern_ripple_2.gh (Grasshopper 1.0.8)

srf = Surface(<surface referenced from the Rhino model>)
pt = Point(<point referenced from the Rhino model>)
Z = UnitZ(Factor=Slider(7.353, range=0..30))
pop2d = Populate2D(Region=srf, Count=Slider(100, range=0..100), Seed=Slider(56, range=0..100))
move = Move(Geometry=pt, Motion=Z)  # -> Geometry, Transform
voronoi = Voronoi(Points=pop2d, BruteForceOverride=False)
pt_2 = Point(<point referenced from the Rhino model>)
pt_3 = Point(<point referenced from the Rhino model>)
number_slider = Slider(20, range=0..100)
planesrf = PlaneSurface(Plane=PlaneXY(0, 0, 0), XSize="-0.5 To 0.5", YSize="-0.5 To 0.5")
sqgrid = Square(Plane=PlaneXY(0, 0, 0), Size=Slider(2, range=0..10), ExtentX=number_slider, ExtentY=number_slider)  # -> Cells, Points
mesh = Mesh(planesrf)
area = Area(Geometry=sqgrid.Cells)  # -> Area, Centroid
cp = ClosestPoint(Point=flatten(area.Centroid), Cloud=flatten([move.Geometry, pt_3, pt_2]))  # -> ClosestPoint, CPIndex, Distance
subtraction = Subtraction(A=cp.Distance, B=Slider(23.423, range=0..60))
move_2 = Move(Geometry=mesh, Motion=area.Centroid)  # -> Geometry, Transform
abs = Absolute(Value=subtraction)
remap = RemapNumbers(Value=flatten([cp.Distance, abs]), Source=flatten(abs), Target=Domain(0, 1))  # -> Mapped, Clipped
graph = GraphMapper(
    remap.Mapped,
    x0=0,
    x1=1,
    y0=0,
    y1=1,
    container_name="Bezier",
    cpx=[0, 0.6899086833, 1, 1],
    cpy=[0.06679701805, 0, 1, 0.9848766327])
gradient = Gradient(LowerLimit=0, UpperLimit=1, Parameter=graph, stops=[0.47: RGB(128, 255, 255), 0.85: RGB(0, 0, 139)])
scale = Scale(Geometry=flatten(move_2.Geometry), Center=flatten(area.Centroid), Factor=flatten(graph))  # -> Geometry, Transform
preview = CustomPreview(Geometry=scale.Geometry, Material=gradient)
